# Grasshopper definition JESS client.gh (Grasshopper 1.0.7)
# plug-ins: FalseStartToggle

ladybug = Ladybug_Ladybug()  # -> out; plug-in component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
honeybee = Honeybee_Honeybee()  # -> out; plug-in component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
boolean_toggle = BooleanToggle(True)
boolean_toggle_2 = BooleanToggle(True)
epoutput = Honeybee_GenerateEPOutput(zoneEnergyUse=boolean_toggle, zoneGainsAndLosses=boolean_toggle, zoneComfortMetrics="False", surfaceTempAnalysis="False")  # -> out, flatten(simulationOutputs); plug-in component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
domain_box = DomainBox(Base=PlaneXY(0, 0, 0), X=Slider(8, range=0..10), Y=Slider(7, range=0..10), Z=Slider(3, range=0..10))
number_slider = Slider(0.6, range=0..1)
mass2zone = Honeybee_Masses2Zones(zoneMasses=flatten(domain_box), isConditioned=boolean_toggle_2, maxRoofAngle=30, createHBZones=boolean_toggle_2)  # -> out, HBZones; plug-in component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
timestep = Slider(10, range=4..10)
glazingcreator = Honeybee_GlazingBasedOnRatio(HBObjects=mass2zone.HBZones, glzRatio=number_slider, breakUpWindow=Toggle(True), runIt=boolean_toggle_2)  # -> out, HBObjWGLZ; plug-in component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
ori = Slider(4, range=0..23, expression="x*15")
format = Format(Format="{0}_{1}_{2}", Culture=127, Data0=timestep, Data1=ori, Data2=number_slider)
energysimpar = Honeybee_EnergySimulationPar(timestep=timestep, solarDistribution="4")  # -> energySimPar; plug-in component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
file_path = FilePath("C:\Users\amd\Documents\GitHub\JEPlus-Grasshopper\EP-BESTEST.epw")
exporttoopenstudio = Honeybee_ExportToOpenStudio(
    north=ori,
    epwWeatherFile=file_path,
    energySimPar=energysimpar,
    HBZones=flatten(glazingcreator.HBObjWGLZ),
    simulationOutputs=flatten(epoutput.simulationOutputs),
    writeOSM=Toggle(True),
    runSimulation=Slider(3, range=0..3),
    fileName=format,
    workingDir="C:\ladybug\jeplus")  # -> out, osmFileAddress, idfFileAddress, resultFileAddress, eioFileAddress, rddFileAddress, htmlReport, studyFolder, model; plug-in component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
lookupfolder_energyplus = Honeybee_LookupEnergyPlusFolder(studyFolder="C:\ladybug\jeplus", refresh=Button())  # -> out, idfFiles, osmFiles, resultFileAddress, scheduleCsvFiles, rddFiles, errFiles, eioFiles, esoFiles, sqlFiles; plug-in component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
panel = Panel(exporttoopenstudio.idfFileAddress)
weather_file = FilePath(file_path)
idf_files = FilePath(lookupfolder_energyplus.idfFiles)
false_start_toggle = FalseStartToggle(False)
# Add .epw to .idf directories
# To create job_dir
ghpython_script = GhPythonScript(idf=idf_files, epw=weather_file)  # -> job_dir
# ---------- ghpython_script: Python ----------
__author__ = "amd"
__version__ = "2020.09.14"

import os
#Get idf directory
idf_dir = os.path.dirname(idf)

import shutil
#copy weather file to idf directory
shutil.copy(epw,idf_dir)

#output job directories
job_dir = idf_dir
# ---------- end ghpython_script ----------
re_run_idf = Honeybee_ReRunIDF(idfFilePath=idf_files, epwFileAddress=weather_file, parallel=Toggle(True), runIt=false_start_toggle)  # -> out, resultFileAddress, eioFileAddress, rddFileAddress; plug-in component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
list_length = ListLength(List=ghpython_script)
panel_2 = Panel(ghpython_script)
panel_3 = Panel(list_length)
false_start_toggle_2 = FalseStartToggle(False)
# 1. Install Java
# 2. Set jar path
# 3. Download JESS client
# 4. Set client
jess_client_3_0_3 = FilePath("C:\JESS_Client_v3.0.3\jess_client.jar")
client_cfg = FilePath("C:\JESS_Client_v3.0.3\client.cfg")
ghpython_script_2 = GhPythonScript(
    jess_client=jess_client_3_0_3,
    cfg_file=client_cfg,
    job_dir="C:\Users\amd\Documents\GitHub\JEPlus-Grasshopper\job_dir",
    download_all=Toggle(True),
    run=false_start_toggle_2)  # -> result; inputs download_all: Boolean, run: Boolean
# ---------- ghpython_script_2: Python ----------
from subprocess import call

#jess_client = "C:\\JESS_Client_v3.0.3\\jess_client.jar"
#cfg_file = "C:\\JESS_Client_v3.0.3\\client.cfg"
#job_dir = "C:\\ladybug\\jeplus\\2_0\\OpenStudio\\2_0\\ModelToIdf\\"

jess_call = ["java", "-jar", jess_client, "-nogui", "-cfg", cfg_file, "-job", job_dir, "-type", "JEPLUS_PROJECT", "-output", "..\\output"]
if download_all == True:
    jess_call.extend(["-result", "ALL"])

if run == True:
    call(jess_call)
    result = "job finished"
else:
    result = jess_call
    print(jess_call)

#java -jar jEPlus.jar -all -parallel 0 -out ../output1 example_1-params_E+v8.9/project.jep.json
#call(["cmd", "/K", "notepad.exe /A " + file + ""]) 
#JEPlus = "C:\Users\amd\Documents\GitHub\JEPlus-Grasshopper\jEPlus_v2.1.0_Beta_05\jEPlus.jar"
#call(["cmd", "/K", "java", "-jar", "C:\\Users\amd\Documents\GitHub\JEPlus-Grasshopper\JESS_Client_v3.0.3\jess_client.jar -nogui -cfg C:\Users\amd\Documents\GitHub\JEPlus-Grasshopper\JESS_Client_v3.0.3\client.cfg -job C:\ladybug\jeplus\2_0\OpenStudio\2_0\ModelToIdf\ -type JEPLUS_PROJECT -output ../output"]) 
#call(["cmd", "/K", "java", "-jar", "C:/Users/amd/Documents/GitHub/JEPlus-Grasshopper/JESS_Client_v3.0.3/jess_client.jar -nogui -cfg C:/Users/amd/Documents/GitHub/JEPlus-Grasshopper/JESS_Client_v3.0.3/client.cfg -job C:/ladybug/jeplus/2_0/OpenStudio/2_0/ModelToIdf/ -type JEPLUS_PROJECT -output ../output"]) 

#call(["cmd", "/K", "C:\Program Files\Java\jdk-14.0.1\bin\java.exe", "-jar", "C:\\Users\amd\Documents\GitHub\JEPlus-Grasshopper\JESS_Client_v3.0.3\jess_client.jar -nogui -cfg C:\Users\amd\Documents\GitHub\JEPlus-Grasshopper\JESS_Client_v3.0.3\client.cfg -job C:\ladybug\jeplus\2_0\OpenStudio\2_0\ModelToIdf\ -type JEPLUS_PROJECT -output ../output"]) 
#x = ["cmd", "/K", "'C:\Program Files\Java\jdk-14.0.1\bin\java.exe'", "-jar", "C:\\Users\amd\Documents\GitHub\JEPlus-Grasshopper\JESS_Client_v3.0.3\jess_client.jar -nogui -cfg C:\Users\amd\Documents\GitHub\JEPlus-Grasshopper\JESS_Client_v3.0.3\client.cfg -job C:\ladybug\jeplus\2_0\OpenStudio\2_0\ModelToIdf\ -type JEPLUS_PROJECT -output ../output"]
#print(x)
#"C:\Users\amd\Documents\GitHub\JEPlus-Grasshopper\jEPlus_v2.1.0_Beta_05\jEPlus.jar"
#java -jar C:\Users\amd\Documents\GitHub\JEPlus-Grasshopper\jEPlus_v2.1.0_Beta_05\jEPlus.jar -all -parallel 0 -out ../output1 C:\ladybug\jeplus\2_0\OpenStudio\2_0\ModelToIdf\Test_run.json
#java -jar JEPlus.jar -all -parallel 0 -out ../output1 C:\ladybug\jeplus\2_0\OpenStudio\2_0\ModelToIdf\Test_run.json
#java -jar C:\Users\amd\Documents\GitHub\JEPlus-Grasshopper\JESS_Client_v3.0.3\jess_client.jar -nogui -cfg C:\Users\amd\Documents\GitHub\JEPlus-Grasshopper\JESS_Client_v3.0.3\client.cfg -job C:\ladybug\jeplus\2_0\OpenStudio\2_0\ModelToIdf\ -type JEPLUS_PROJECT -output ../output
# ---------- end ghpython_script_2 ----------
panel_4 = Panel(ghpython_script_2)
