# Grasshopper definition JESS.gh (Grasshopper 1.0.7)
# plug-ins: GH_CPython, jSwan, FalseStartToggle, Human

# GH_CPython with python 3.8 is used
# to use requests module
# Use sticky to remove the need for cookie wires
panel = Panel("C:/Users/amd/Documents/GitHub/JESS-Grasshopper/cookie.txt")
# Components in classic python2 that use py3 CLI
panel_2 = Panel("C:\\Users\\amd\\AppData\\Local\\Programs\\Python\\Python38\\python.exe")
panel_3 = Panel("C:\\Users\\amd\\Documents\\GitHub\\JESS-Grasshopper\\JESS_CLI.py")
false_start_toggle = FalseStartToggle(True)
# BASE
# Users API: https://api.ensims.com/users/api
# JESS API: https://api.ensims.com/jess_web/api
false_start_toggle_2 = FalseStartToggle(True)
# Native python in Grasshopper uses urllib, urllib2.
# Ironpython is not compatible with "requests" module
# I need to create JEPLUS CLI in python 3 which can be called from python 2
urllib = GhPythonScript()  # -> out, a
# ---------- urllib: Python ----------
__author__ = "amd"
__version__ = "2020.09.27"

import urllib, urllib2
print(dir(urllib2))
# ---------- end urllib ----------
eto_form = GhPythonScript(run=false_start_toggle)  # -> login, password
# ---------- eto_form: Python ----------
#This script is based on source code https://developer.rhino3d.com/guides/rhinopython/eto-forms-python/#the-layout

import Rhino
import scriptcontext
import System
import Rhino.UI
import Eto.Drawing as drawing
import Eto.Forms as forms

# Eto dialog class
class EtoDialogClass(forms.Dialog[bool]):

    # Dialog box Class initializer
    def __init__(self):
        # Initialize dialog box
        self.Title = 'ENSIMS/JESS login'
        self.Padding = drawing.Padding(10)
        self.Resizable = False

        # Create controls for the dialog
        self.m_label = forms.Label(Text = 'Enter the login:')
        self.m_textbox = forms.TextBox(Text = None)
        self.p_label = forms.Label(Text = 'Enter the password:')
        self.p_textbox = forms.PasswordBox()

        # Create the default button
        self.DefaultButton = forms.Button(Text = 'OK')
        self.DefaultButton.Click += self.OnOKButtonClick

        # Create the abort button
        self.AbortButton = forms.Button(Text = 'Cancel')
        self.AbortButton.Click += self.OnCloseButtonClick

        # Create a table layout and add all the controls
        layout = forms.DynamicLayout()
        layout.Spacing = drawing.Size(5, 5)
        layout.AddRow(self.m_label, self.m_textbox)
        layout.AddRow(self.p_label, self.p_textbox)
        layout.AddRow(None) # spacer
        layout.AddRow(self.DefaultButton, self.AbortButton)

        # Set the dialog content
        self.Content = layout

    # Start of the class functions
    global data
    # Get the value of the textbox
    def GetText(self):
        data = {"login":self.m_textbox.Text, "password":self.p_textbox.Text}
        return data

    def GetLogin(self):
        return self.m_textbox.Text

    def GetPassword(self):
        return self.p_textbox.Text

    # Close button click handler
    def OnCloseButtonClick(self, sender, e):
        self.m_textbox.Text = ""
        self.Close(False)

    # OK button click handler
    def OnOKButtonClick(self, sender, e):
        if self.m_textbox.Text == "":
            self.Close(False)
        else:
            self.Close(True)

    ## End of Dialog Class ##

# The script that will be using the dialog.
def LoginDialog():
    dialog = EtoDialogClass();
    rc = dialog.ShowModal(Rhino.UI.RhinoEtoApp.MainWindow)
    global login, password
    login = dialog.GetLogin()
    password = dialog.GetPassword()
    if (rc):
        print dialog.GetText() #Print the Room Number from the dialog control

##########################################################################
# Check to see if this file is being executed as the "main" python
# script instead of being used as a module by some other python script
# This allows us to use the module which ever way we want.
if __name__ == "__main__":
    if run == True:
        LoginDialog()
# ---------- end eto_form ----------
eto_form_2 = GhPythonScript(Python3=panel_2, JESS_CLI=panel_3, run=false_start_toggle_2)  # -> cookie
# ---------- eto_form_2: Python ----------
"""This component requests cookie from the JESS
    Inputs:
        Python3: The filepath to the 3.X python interpreter
        JESS_CLI: The filepath to the JESS CLI
        run: Set to True to run the component
    Output:
        cookie: Cookie value
"""
#This script is based on source code https://developer.rhino3d.com/guides/rhinopython/eto-forms-python/#the-layout

import Rhino
import scriptcontext
import System
import Rhino.UI
import Eto.Drawing as drawing
import Eto.Forms as forms

# Eto dialog class
class EtoDialogClass(forms.Dialog[bool]):

    # Dialog box Class initializer
    def __init__(self):
        # Initialize dialog box
        self.Title = 'ENSIMS/JESS login'
        self.Padding = drawing.Padding(10)
        self.Resizable = False

        # Create controls for the dialog
        self.m_label = forms.Label(Text = 'User email:')
        self.m_textbox = forms.TextBox(Text = None)
        self.p_label = forms.Label(Text = 'Password:')
        self.p_textbox = forms.PasswordBox()

        # Create the default button
        self.DefaultButton = forms.Button(Text = 'OK')
        self.DefaultButton.Click += self.OnOKButtonClick

        # Create the abort button
        self.AbortButton = forms.Button(Text = 'Cancel')
        self.AbortButton.Click += self.OnCloseButtonClick

        # Create a table layout and add all the controls
        layout = forms.DynamicLayout()
        layout.Spacing = drawing.Size(5, 5)
        layout.AddRow(self.m_label, self.m_textbox)
        layout.AddRow(self.p_label, self.p_textbox)
        layout.AddRow(None) # spacer
        layout.AddRow(self.DefaultButton, self.AbortButton)

        # Set the dialog content
        self.Content = layout

    # Start of the class functions
    global data
    # Get the value of the textbox
    def GetText(self):
        data = {"user_email":self.m_textbox.Text, "password":self.p_textbox.Text}
        return data

    def GetLogin(self):
        return self.m_textbox.Text

    def GetPassword(self):
        return self.p_textbox.Text

    # Close button click handler
    def OnCloseButtonClick(self, sender, e):
        self.m_textbox.Text = ""
        self.Close(False)

    # OK button click handler
    def OnOKButtonClick(self, sender, e):
        if self.m_textbox.Text == "":
            self.Close(False)
        else:
            self.Close(True)

    ## End of Dialog Class ##

# The script that will be using the dialog.
def LoginDialog():
    dialog = EtoDialogClass();
    rc = dialog.ShowModal(Rhino.UI.RhinoEtoApp.MainWindow)
    if (rc):
        dialog.GetText() #Print the Room Number from the dialog control
        user_email = dialog.GetLogin()
        password = dialog.GetPassword()
    
    import subprocess
    commands = [Python3, JESS_CLI, "cookie", user_email, password]
    cookie = subprocess.check_output(commands,
                                     stderr=subprocess.STDOUT,
                                     shell=True)
    return cookie.strip()

##########################################################################
# Check to see if this file is being executed as the "main" python
# script instead of being used as a module by some other python script
# This allows us to use the module which ever way we want.
if __name__ == "__main__":
    if run == True:
        cookie = LoginDialog()
        import scriptcontext as sc
        sc.sticky["cookie"] = cookie
        sc.sticky["Python3"] = Python3
        sc.sticky["JESS_CLI"] = JESS_CLI
        print(len(cookie.strip()))
# ---------- end eto_form_2 ----------
ensims_login = EnsimsLogin(login=eto_form.login, password=eto_form.password, cookie=panel)  # -> output, cookie; inputs login: list, password: list, cookie: list
# ---------- ensims_login: Python ----------
# -*- coding: utf-8 -*-
""" 
Python Script
Created on  Sunday September 2020 09:06:17 
@author:  amd 

[desc]
Description of the plugin Here
Write here any thing... 
[/desc]

ARGUMENTS:
----------
<inp> 
    login :[required] - [type = string] - [default = None] 
    Descripe your input here 
        * bullet point
</inp>
<inp> 
    password :[required] - [type = string] - [default = None] 
    Descripe your input here 
        * bullet point
</inp>
<inp> 
    cookie :[required] - [type = string] - [default = None] 
    Descripe your input here 
        * bullet point
</inp>
RETURN:
----------
    <out>
        output : indicate your output description here. \n refers to a new line.
    </out>
    <out>
        cookie : indicate your output description here. \n refers to a new line.
    </out>
"""

import requests, pickle
ApiBase = 'https://api.ensims.com/'
UserApi = ApiBase + 'users/api/'
r = requests.get(UserApi + 'info')

# Set header and body of the POST request
headers = {'Content-Type': 'application/json'}
body = {"email": login, "password": password}
r = requests.post(UserApi + 'auth', headers=headers, json=body)
cookies = r.cookies

#dump cookies into file
with open(cookie, 'wb') as f:
    pickle.dump(r.cookies, f)
output = []
output.append(r.json())
r = requests.post(UserApi + 'checkin', cookies=cookies)
if r.json()['ok']:
    cookies = r.cookies
    output.append(r.json())
else:
    cookie = None
# ---------- end ensims_login ----------
# {
#     "command": "Create",
#     "projectID": "circle-py",
#     "problem": {
#         "name": "circle",
#         "description": "Test constrained mo fucntion with two variables",
#         "variables": [
#             {
#                 "name": "x",
#                 "caption": "x in [0, 1]",
#                 "valueStr": "[0:0.01:1]",
#                 "maskStr": "[0:0.1:1]",
#                 "valueType": "Number"
#             },
#             {
#                 "name": "y",
#                 "caption": "y in [0, 1]",
#                 "valueStr": "[0:0.01:1]",
#                 "maskStr": "[0:0.1:1]",
#                 "valueType": "Number"
#             }
#         ],
#         "evalResults": [
#             {
#                 "name": "f1",
#                 "caption": "Evaluation f1 = 100 * x",
#                 "unit": "-"
#             },
#             {
#                 "name": "f2",
#                 "caption": "Evaluation f2 = 100 * y",
#                 "unit": "-"
#             }
#         ],
#         "userMetrics": [],
#         "objectives": [
#             {
#                 "name": "t1",
#                 "caption": "Objective t1 = f1",
#                 "unit": "-",
#                 "direction": "Minimize",
#                 "formula": "f1"
#             },
#             {
#                 "name": "t2",
#                 "caption": "Objective t2 = f2",
#                 "unit": "-",
#                 "direction": "Minimize",
#                 "formula": "f2"
#             }
#         ],
#         "constraints": [
#             {
#                 "name": "s1",
#                 "caption": "Constraint s1 <= 30",
#                 "unit": "-",
#                 "formula": "Math.sqrt(Math.pow(f1-50, 2) + Math.pow(f2-50, 2))",
#                 "lb": 0,
#                 "ub": 30,
#                 "min": 0,
#                 "max": 100,
#                 "weight": 1
#             }
#         ]
#     },
#     "config": {
#         "algorithm": "Parametrics",
#         "sampleSize": 0,
#         "initSampleOption": "RANDOM",
#         "initPopSize": 10,
#         "evolvePopSize": 10,
#         "maxPopSize": 10000,
#         "mutationRate": 0.2,
#         "crossoverRate": 1,
#         "tournamentSize": 2,
#         "objectiveBias": 0,
#         "elitismTolerance": 0,
#         "maxGenerations": 100,
#         "maxEvaluations": 1000,
#         "maxComputingTime": 100,
#         "maxWallTime": 24
#     },
#     "smdata": {
#         "modelID": "circle",
#         "model": "",
#         "type": "Python3"
#     }
# }
false_start_toggle_3 = FalseStartToggle(False)
# URL
# GET: #Users API info
# https://api.ensims.com/users/api/info
# # retrieve a file in a particular folder
# r = requests.get(UserApi + 'files/' + file, cookies=r.cookies)
# # View folder contents
# r = requests.get(UserApi + 'files/' + folder, cookies=r.cookies)
# POST: #Check-in
# r = requests.post(UserApi + 'checkin', cookies=r.cookies)
# # POST files to JESS
# files = {'file': open(file, 'rb')}
# r = requests.post(UserApi + 'files/' + folder, files=files, cookies=r.cookies)
# DELETE: # Delete the folder
# r = requests.delete(UserApi + 'files/' + folder, cookies=r.cookies)
# POST: # Post job on jess client and get job ID
# r = requests.post(JessApi + 'job', files=files, cookies=r.cookies)
# GET: # GET specific text with job_id and filename
# r = requests.get(JessApi + 'job/file/' + job_id + '/' + filename, cookies=r.cookies)
# # GET job status with job_id
# r = requests.get(JessApi + 'job/dir/' + job_id, cookies=r.cookies)
# # Download all job output in as a zip file
# r = requests.get(JessApi + 'job/file/' + job_id, cookies=r.cookies)
# # Get job status by ID
# r = requests.get(JessApi + 'job/status/' + job_id, cookies=r.cookies)
# # GET job output file list by job_id
# r = requests.get(JessApi + 'job/dir/' + job_id, cookies=r.cookies)
panel_4 = Panel("https://api.ensims.com/users/api/files/test/0/Shoebox_v8.9/cntr_Heathrow_TRY.epw")
panel_5 = Panel(ensims_login.output)
# https://api.ensims.com/users/api/info
panel_6 = Panel("https://api.ensims.com/jess_web/api/info")
ghpython_script = GhPythonScript()  # -> cookie
# ---------- ghpython_script: Python ----------
__author__ = "BT"
__version__ = "2020.09.29"

import scriptcontext as rs

cookie = rs.sticky["cookie"] #output the value of the sticky
# ---------- end ghpython_script ----------
eto_form_3 = GhPythonScript(run=false_start_toggle_3)  # -> login, password
# ---------- eto_form_3: Python ----------
#source code https://developer.rhino3d.com/guides/rhinopython/eto-forms-python/#the-layout

# Imports
import Rhino
import scriptcontext
import System
import Rhino.UI
import Eto.Drawing as drawing
import Eto.Forms as forms

# SampleEtoRoomNumber dialog class
class SampleEtoRoomNumberDialog(forms.Dialog[bool]):

    # Dialog box Class initializer
    def __init__(self):
        # Initialize dialog box
        self.Title = 'ENSIMS/JESS login'
        self.Padding = drawing.Padding(10)
        self.Resizable = False

        # Create controls for the dialog
        self.m_label = forms.Label(Text = 'Enter the login:')
        self.m_textbox = forms.TextBox(Text = None)
        self.p_label = forms.Label(Text = 'Enter the password:')
        self.p_textbox = forms.TextBox(Text = None)

        # Create the default button
        self.DefaultButton = forms.Button(Text = 'OK')
        self.DefaultButton.Click += self.OnOKButtonClick

        # Create the abort button
        self.AbortButton = forms.Button(Text = 'Cancel')
        self.AbortButton.Click += self.OnCloseButtonClick

        # Create a table layout and add all the controls
        layout = forms.DynamicLayout()
        layout.Spacing = drawing.Size(5, 5)
        layout.AddRow(self.m_label, self.m_textbox)
        layout.AddRow(self.p_label, self.p_textbox)
        layout.AddRow(None) # spacer
        layout.AddRow(self.DefaultButton, self.AbortButton)

        # Set the dialog content
        self.Content = layout

    # Start of the class functions
    global data
    # Get the value of the textbox
    def GetText(self):
        data = {"login":self.m_textbox.Text, "password":self.p_textbox.Text}
        return data

    def GetLogin(self):
        return self.m_textbox.Text

    def GetPassword(self):
        return self.p_textbox.Text

    # Close button click handler
    def OnCloseButtonClick(self, sender, e):
        self.m_textbox.Text = ""
        self.Close(False)

    # OK button click handler
    def OnOKButtonClick(self, sender, e):
        if self.m_textbox.Text == "":
            self.Close(False)
        else:
            self.Close(True)

    ## End of Dialog Class ##

# The script that will be using the dialog.
def RequestRoomNumber():
    dialog = SampleEtoRoomNumberDialog();
    rc = dialog.ShowModal(Rhino.UI.RhinoEtoApp.MainWindow)
    global login, password
    login = dialog.GetLogin()
    password = dialog.GetPassword()
    if (rc):
        print dialog.GetText() #Print the Room Number from the dialog control

##########################################################################
# Check to see if this file is being executed as the "main" python
# script instead of being used as a module by some other python script
# This allows us to use the module which ever way we want.
if __name__ == "__main__":
    if run == True:
        RequestRoomNumber()
# ---------- end eto_form_3 ----------
panel_7 = Panel("""('file', ('5ZoneAirCooled-v93.idf', open("C:/Users/amd/Documents/GitHub/JESS-Grasshopper/job_example/5ZoneAirCooled-v93.idf", 'rb'), 'text/plain'))
('file', ('in.epw', open("C:/Users/amd/Documents/GitHub/JESS-Grasshopper/job_example/in.epw", 'rb'), 'text/plain'))
('title', 'Test job')
('desc', 'This is test submission made from python example')
('model', '5ZoneAirCooled-v93.idf')
('split', 'FALSE')
('weather', 'in.epw')""")
create_jea_project = CreateJEAProject(cookie=ghpython_script)  # -> output, project_id; inputs cookie: list
# ---------- create_jea_project: Python ----------
# -*- coding: utf-8 -*-
""" 
Python Script
Created on  Tuesday September 2020 08:46:17 
@author:  BT 

[desc]
Description of the plugin Here
Write here any thing... 
[/desc]

ARGUMENTS:
----------
<inp> 
    cookie :[required] - [type = string] - [default = None] 
    Descripe your input here 
        * bullet point.
        * bullet point
</inp>
<inp> 
    json :[required] - [type = string] - [default = None] 
    Descripe your input here 
        * bullet point.
        * bullet point
</inp>

RETURN:
----------
    <out>
        output : indicate your output description here. \n refers to a new line.
    </out>

"""
import requests, pickle

# API endpoint URL
ApiBase = 'https://api.ensims.com/'
JeaApi = ApiBase + "jea_web/api/"

#Load cookie
r = requests.get(JeaApi + 'info')
with open(cookie, 'rb') as f:
    r.cookies.update(pickle.load(f))

json = {
    "command": "Create",
    "projectID": "circle-py",
    "problem": {
        "name": "circle",
        "description": "Test constrained mo fucntion with two variables",
        "variables": [
            {
                "name": "x",
                "caption": "x in [0, 1]",
                "valueStr": "[0:0.01:1]",
                "maskStr": "[0:0.1:1]",
                "valueType": "Number"
            },
            {
                "name": "y",
                "caption": "y in [0, 1]",
                "valueStr": "[0:0.01:1]",
                "maskStr": "[0:0.1:1]",
                "valueType": "Number"
            }
        ],
        "evalResults": [
            {
                "name": "f1",
                "caption": "Evaluation f1 = 100 * x",
                "unit": "-"
            },
            {
                "name": "f2",
                "caption": "Evaluation f2 = 100 * y",
                "unit": "-"
            }
        ],
        "userMetrics": [],
        "objectives": [
            {
                "name": "t1",
                "caption": "Objective t1 = f1",
                "unit": "-",
                "direction": "Minimize",
                "formula": "f1"
            },
            {
                "name": "t2",
                "caption": "Objective t2 = f2",
                "unit": "-",
                "direction": "Minimize",
                "formula": "f2"
            }
        ],
        "constraints": [
            {
                "name": "s1",
                "caption": "Constraint s1 <= 30",
                "unit": "-",
                "formula": "Math.sqrt(Math.pow(f1-50, 2) + Math.pow(f2-50, 2))",
                "lb": 0,
                "ub": 30,
                "min": 0,
                "max": 100,
                "weight": 1
            }
        ]
    },
    "config": {
        "algorithm": "Parametrics",
        "sampleSize": 0,
        "initSampleOption": "RANDOM",
        "initPopSize": 10,
        "evolvePopSize": 10,
        "maxPopSize": 10000,
        "mutationRate": 0.2,
        "crossoverRate": 1,
        "tournamentSize": 2,
        "objectiveBias": 0,
        "elitismTolerance": 0,
        "maxGenerations": 100,
        "maxEvaluations": 1000,
        "maxComputingTime": 100,
        "maxWallTime": 24
    },
    "smdata": {
        "modelID": "circle",
        "model": "",
        "type": "Python3"
    }
}

project_id = json['projectID']

# Send command
r = requests.post(JeaApi + 'command', json=json, cookies=r.cookies)

# Show response
output = r.json()
# ---------- end create_jea_project ----------
jess_login = JESSLogin(login=eto_form_3.login, password=eto_form_3.password, cookie=ensims_login.cookie)  # -> output; inputs login: list, password: list, cookie: list
# ---------- jess_login: Python ----------
# -*- coding: utf-8 -*-
""" 
Python Script
Created on  Sunday September 2020 09:06:17 
@author:  amd 

[desc]
Description of the plugin Here
Write here any thing... 
[/desc]

ARGUMENTS:
----------
<inp> 
    login :[required] - [type = string] - [default = None] 
    Descripe your input here 
        * bullet point.
        * bullet point
</inp>
<inp> 
    password :[required] - [type = string] - [default = None] 
    Descripe your input here 
        * bullet point.
        * bullet point
</inp>
<inp>
    Other inputs go here ...
</inp>

RETURN:
----------
    <out>
        output_ : indicate your output description here. \n refers to a new line.
    </out>

"""
# Use requests (see https://requests.readthedocs.io/en/master/)
import requests, pickle

# API endpoint URL
ApiBase = 'https://api.ensims.com/'
JessApi = ApiBase + 'jess_web/api/'

#Load ENSIMS cookie
r = requests.get(JessApi + 'info')
with open(cookie, 'rb') as f:
    r.cookies.update(pickle.load(f))

# Set header and body of the POST request
headers = {'Content-Type': 'application/json'}
body = {"jessUser": login, "jessPwd": password}
r = requests.post(JessApi + 'session', headers=headers, json=body, cookies=r.cookies)
output = r.json()
# ---------- end jess_login ----------
post = GhPythonScript(url="https://api.ensims.com/users/api/checkin")  # -> output, data
# ---------- post: Python ----------
"""Requests POST method
    Inputs:
        url: The url that contains both base and url
        file: The filepath for the file
    Output:
        data: Requsts response
"""

__author__ = "amd"
__version__ = "2020.11.14"

import scriptcontext as sc
import subprocess

Python3 = sc.sticky['Python3']
JESS_CLI = sc.sticky['JESS_CLI']
cookie = sc.sticky['cookie']

if file == None:
    args = ['post', cookie, url]
else:
    print(file)
    args = ['postf', cookie, url, file]

comm = subprocess.Popen([Python3, JESS_CLI] + args, stdout = subprocess.PIPE)
data, error = comm.communicate()
print(data)
comm.stdout.close()
comm.wait()
# ---------- end post ----------
get = GhPythonScript(url=panel_6)  # -> output, data
# ---------- get: Python ----------
"""Requests GET method
    Inputs:
        url: The url that contains both base and url
    Output:
        data: Requsts response
"""
__author__ = "amd"
__version__ = "2020.11.14"

import scriptcontext as sc
import subprocess
Python3 = sc.sticky['Python3']
JESS_CLI = sc.sticky['JESS_CLI']
cookie = sc.sticky['cookie']

args = ['get', cookie, url]
comm = subprocess.Popen([Python3, JESS_CLI] + args, stdout = subprocess.PIPE)
data, error = comm.communicate()
print(data)
comm.stdout.close()
# ---------- end get ----------
delete = GhPythonScript(url=panel_4)  # -> output, data
# ---------- delete: Python ----------
"""Requests DELETE method
    Inputs:
        url: The url that contains base, url and (file or folder) path
    Output:
        data: Requsts response
"""

__author__ = "amd"
__version__ = "2020.11.14"

import scriptcontext as sc
import subprocess
Python3 = sc.sticky['Python3']
JESS_CLI = sc.sticky['JESS_CLI']
cookie = sc.sticky['cookie']

args = ['delete', cookie, url]
comm = subprocess.Popen([Python3, JESS_CLI] + args, stdout = subprocess.PIPE)
data, error = comm.communicate()
print(data)
comm.stdout.close()
comm.wait()
# ---------- end delete ----------
panel_8 = Panel(create_jea_project.output)
panel_9 = Panel(jess_login)
get_jea_status = GetJEAStatus(cookie=ghpython_script, project_id=create_jea_project.project_id)  # -> output; inputs cookie: list, project_id: list
# ---------- get_jea_status: Python ----------
# -*- coding: utf-8 -*-
""" 
Python Script
Created on  Tuesday September 2020 08:46:17 
@author:  BT 

[desc]
Description of the plugin Here
Write here any thing... 
[/desc]

ARGUMENTS:
----------
<inp> 
    _input :[required] - [type = int] - [default = None] 
    Descripe your input here 
        * bullet point.
        * bullet point
</inp>
<inp>
    Other inputs go here ...
</inp>

RETURN:
----------
    <out>
        output_ : indicate your output description here. \n refers to a new line.
    </out>

"""
import requests, pickle

# API endpoint URL
ApiBase = 'https://api.ensims.com/'
JeaApi = ApiBase + "jea_web/api/"

#Load cookie
r = requests.get(JeaApi + 'info')
with open(cookie, 'rb') as f:
    r.cookies.update(pickle.load(f))

# Get the status of the project
r = requests.get(JeaApi + 'start/' + project_id, cookies=r.cookies)

# Show response
output = r.json()
# ---------- end get_jea_status ----------
panel_10 = Panel("""job/file
job/dir
job/file
job/status""")
panel_11 = Panel(get.data)
panel_12 = Panel(post.data)
panel_13 = Panel(delete.data)
# TODO
# Comparison tests
# 1. parametric run with multiple jobs
# 2. big idf file 10min+
cookie = Data(ensims_login.cookie)
panel_14 = Panel(get_jea_status)
panel_15 = Panel("C:/Users/amd/Documents/GitHub/JESS-Grasshopper/job_example/Shoebox_v8.9.zip")
item_selector = ItemSelector(panel_10, {"job/file", "job/dir", "job/file", "job/status"}, selected="job/file")
cookie_2 = Data(ensims_login.cookie)
# 2: [('file', ('5ZoneAirCooled-v93.idf', open('job_example\\5ZoneAirCooled-v93.idf', 'rb'), 'text/plain')),('file', ('in.epw', open('job_example\\in.epw', 'rb'), 'text/plain')),('title', 'Test job'),('desc', 'Grasshopper Test'),('model', '5ZoneAirCooled-v93.idf'),('split', 'FALSE'),('weather', 'in.epw')]
_1 = Panel("{('file', ('5ZoneAirCooled-v93.idf', open('job_example\\5ZoneAirCooled-v93.idf', 'rb'), 'text/plain')),('file', ('in.epw', open('job_example\\in.epw', 'rb'), 'text/plain')),('title', 'Test job'),('desc', 'Grasshopper Test'),('model', '5ZoneAirCooled-v93.idf'),('split', 'FALSE'),('weather', 'in.epw')}")
check_cookie = CheckCookie(cookie=ensims_login.cookie)  # -> output, cookie; inputs cookie: list
# ---------- check_cookie: Python ----------
# -*- coding: utf-8 -*-
""" 
Python Script
Created on  Sunday September 2020 09:40:26 
@author:  amd 

[desc]
Description of the plugin Here
Write here any thing... 
[/desc]

ARGUMENTS:
----------
<inp> 
    cookie :[required] - [type = string] - [default = None] 
    Descripe your input here 
        * bullet point
</inp>

RETURN:
----------
    <out>
        output : indicate your output description here. \n refers to a new line.
    </out>

"""

import requests, pickle

# API endpoint URL
ApiBase = 'https://api.ensims.com/'
# ApiBase = 'https://localhost:8443/'
UserApi = ApiBase + 'users/api/'

#Load cookie
r = requests.get(UserApi + 'info')
with open(cookie, 'rb') as f:
    r.cookies.update(pickle.load(f))

#Check-in
r = requests.post(UserApi + 'checkin', cookies=r.cookies)

# Update the copy of the key if successful
if r.json()['ok']:
    cookie = r.cookies

# Show the response
output = r.json()
# ---------- end check_cookie ----------
upload_files = UploadFiles(cookie=cookie, folder="test/0", file=panel_15)  # -> output; inputs cookie: list, folder: list, file: list
# ---------- upload_files: Python ----------
# -*- coding: utf-8 -*-
""" 
Python Script
Created on  Sunday September 2020 10:05:19 
@author:  amd 

[desc]
Description of the plugin Here
Write here any thing... 
[/desc]

ARGUMENTS:
----------
<inp> 
    _input :[required] - [type = int] - [default = None] 
    Descripe your input here 
        * bullet point.
        * bullet point
</inp>
<inp>
    Other inputs go here ...
</inp>

RETURN:
----------
    <out>
        output_ : indicate your output description here. \n refers to a new line.
    </out>

"""
import requests, pickle

# API endpoint URL
ApiBase = 'https://api.ensims.com/'
# ApiBase = 'https://localhost:8443/'
UserApi = ApiBase + 'users/api/'

#Load cookie
r = requests.get(UserApi + 'info')
with open(cookie, 'rb') as f:
    r.cookies.update(pickle.load(f))

# upload a file to a particular folder
files = {'file': open(file, 'rb')}

# POST with files
r = requests.post(UserApi + 'files/' + folder, files=files, cookies=r.cookies)

# Show the returned status
output = r.json()
# ---------- end upload_files ----------
view_folder = ViewFolder(cookie=cookie, folder="test/0")  # -> output; inputs cookie: list, folder: list
# ---------- view_folder: Python ----------
# -*- coding: utf-8 -*-
""" 
Python Script
Created on  Sunday September 2020 10:05:19 
@author:  amd 

[desc]
Description of the plugin Here
Write here any thing... 
[/desc]

ARGUMENTS:
----------
<inp> 
    _input :[required] - [type = int] - [default = None] 
    Descripe your input here 
        * bullet point.
        * bullet point
</inp>
<inp>
    Other inputs go here ...
</inp>

RETURN:
----------
    <out>
        output_ : indicate your output description here. \n refers to a new line.
    </out>

"""
import requests, pickle

# API endpoint URL
ApiBase = 'https://api.ensims.com/'
# ApiBase = 'https://localhost:8443/'
UserApi = ApiBase + 'users/api/'

#Load cookie
r = requests.get(UserApi + 'info')
with open(cookie, 'rb') as f:
    r.cookies.update(pickle.load(f))

# View folder contents
r = requests.get(UserApi + 'files/' + folder, cookies=r.cookies)

# Show the returned status
try: 
    output = r.json()
except:
    output = "No directory called: " + folder
# ---------- end view_folder ----------
delete_folder = DeleteFolder(cookie=cookie, folder="/test/0/Shoebox_v8.9/cntr_Heathrow_TRY.epw")  # -> output; inputs cookie: list, folder: list
# ---------- delete_folder: Python ----------
# -*- coding: utf-8 -*-
""" 
Python Script
Created on  Sunday September 2020 10:05:19 
@author:  amd 

[desc]
Description of the plugin Here
Write here any thing... 
[/desc]

ARGUMENTS:
----------
<inp> 
    _input :[required] - [type = int] - [default = None] 
    Descripe your input here 
        * bullet point.
        * bullet point
</inp>
<inp>
    Other inputs go here ...
</inp>

RETURN:
----------
    <out>
        output_ : indicate your output description here. \n refers to a new line.
    </out>

"""
import requests, pickle

# API endpoint URL
ApiBase = 'https://api.ensims.com/'
# ApiBase = 'https://localhost:8443/'
UserApi = ApiBase + 'users/api/'

#Load cookie
r = requests.get(UserApi + 'info')
with open(cookie, 'rb') as f:
    r.cookies.update(pickle.load(f))

# Delete the folder
r = requests.delete(UserApi + 'files/' + folder, cookies=r.cookies)

# Show the returned status
output = r.json()
# ---------- end delete_folder ----------
post_job = PostJob(cookie=cookie_2, files=panel_7)  # -> output, job_id; inputs files: list
# ---------- post_job: Python ----------
# -*- coding: utf-8 -*-
""" 
Python Script
Created on  Sunday September 2020 10:05:19 
@author:  amd 

[desc]
Description of the plugin Here
Write here any thing... 
[/desc]

ARGUMENTS:
----------
<inp> 
    cookie :[required] - [type = string] - [default = None] 
    Descripe your input here 
        * bullet point.
        * bullet point
</inp>
<inp>
    files :[required] - [type = string] - [default = None] 
    Descripe your input here 
        * bullet point.
        * bullet point
</inp>

RETURN:
----------
    <out>
        output_ : indicate your output description here. \n refers to a new line.
    </out>

"""
import requests, pickle

ApiBase = 'https://api.ensims.com/'
JessApi = ApiBase + "jess_web/api/"

#Load cookie
r = requests.get(JessApi + 'info')
with open(cookie, 'rb') as f:
    r.cookies.update(pickle.load(f))

print(files)
# Post job on jess client and get job ID
r = requests.post(JessApi + 'job', files=files, cookies=r.cookies)

# Show the returned status
output = r.json()
job_id = r.json()['data']
# ---------- end post_job ----------
download_file = DownloadFile(cookie=cookie, file="test/0/win.ini")  # -> output; inputs cookie: list, file: list
# ---------- download_file: Python ----------
# -*- coding: utf-8 -*-
""" 
Python Script
Created on  Sunday September 2020 10:05:19 
@author:  amd 

[desc]
Description of the plugin Here
Write here any thing... 
[/desc]

ARGUMENTS:
----------
<inp> 
    _input :[required] - [type = int] - [default = None] 
    Descripe your input here 
        * bullet point.
        * bullet point
</inp>
<inp>
    Other inputs go here ...
</inp>

RETURN:
----------
    <out>
        output_ : indicate your output description here. \n refers to a new line.
    </out>

"""
import requests, pickle

# API endpoint URL
ApiBase = 'https://api.ensims.com/'
# ApiBase = 'https://localhost:8443/'
UserApi = ApiBase + 'users/api/'

#Load cookie
r = requests.get(UserApi + 'info')
with open(cookie, 'rb') as f:
    r.cookies.update(pickle.load(f))

# retrieve a file in a particular folder
r = requests.get(UserApi + 'files/' + file, cookies=r.cookies)

# Show the contents of the downloaded file
output = r.text
# ---------- end download_file ----------
# Users API: https://api.ensims.com/users/api/
# ('file', ('5ZoneAirCooled-v93.idf', open('C:/Users/amd/Documents/GitHub/JESS-Grasshopper/job_example/5ZoneAirCooled-v93.idf', 'rb'), 'text/plain'))
# ('file', ('in.epw', open('C:/Users/amd/Documents/GitHub/JESS-Grasshopper/job_example/in.epw', 'rb'), 'text/plain'))
# ('title', 'Test job')
# ('desc', 'This is test submission made from python example')
# ('model', '5ZoneAirCooled-v93.idf')
# ('split', 'FALSE')
# ('weather', 'in.epw')
jess_api = Panel("https://api.ensims.com/jess_web/api/")
# JESS API: https://api.ensims.com/jess_web/api/
users_api = Panel("https://api.ensims.com/users/api/")
panel_16 = Panel(post_job.output)
panel_17 = Panel(check_cookie.output)
panel_18 = Panel(view_folder)
panel_19 = Panel(upload_files)
panel_20 = Panel(download_file)
panel_21 = Panel(delete_folder)
panel_22 = Panel("{'file': open('C:/Users/amd/Documents/GitHub/JESS-Grasshopper/job_example/Shoebox_v8.9.zip', 'rb')}")
# POST JOB: ApiBase = 'https://api.ensims.com/'
# JessApi = ApiBase + "jess_web/api/"
# 
# # Post job on jess client and get job ID
# r = requests.post(JessApi + 'job', files=files, cookies=r.cookies)
panel_23 = Panel("{0}{1}{2}")
job_id = Data(post_job.job_id)
folder = Panel("test/0")
format = Format(Format=panel_23, Culture=127, Data0=jess_api, Data1="job")
check_status = CheckStatus(cookie=cookie_2, job_id=post_job.job_id)  # -> output
# ---------- check_status: Python ----------
# -*- coding: utf-8 -*-
""" 
Python Script
Created on  Monday September 2020 12:08:26 
@author:  amd 

[desc]
Description of the plugin Here
Write here any thing... 
[/desc]

ARGUMENTS:
----------
<inp> 
    job_id :[required] - [type = string] - [default = None] 
    Descripe your input here 
        * bullet point.
        * bullet point
</inp>
<inp>
    cookie :[required] - [type = string] - [default = None] 
    Descripe your input here 
        * bullet point.
        * bullet point
</inp>

RETURN:
----------
    <out>
        output : indicate your output description here. \n refers to a new line.
    </out>

"""
import requests, pickle, sys, io, json

def get_job_status(job_id, cookie):
    #API endpoint URL
    ApiBase = 'https://api.ensims.com/'
    JessApi = ApiBase + "jess_web/api/"
    r = requests.get(JessApi + 'info')

    #Load cookie
    with open(cookie, 'rb') as f:
        r.cookies.update(pickle.load(f))

    #print('job/status/' + str(job_id))
    # Get job status by ID
    r = requests.get(JessApi + 'job/status/' + job_id, cookies=r.cookies)
    #output = r.json()['data']['status']
    return r.json()

output = get_job_status(job_id, cookie)
# ---------- end check_status ----------
format_2 = Format(Format="{0}{1}{2}", Culture=127, Data0=users_api, Data1="files/", Data2=folder)
retrieve_job_output = RetrieveJobOutput(cookie=cookie_2, job_id=job_id)  # -> output; inputs cookie: list
# ---------- retrieve_job_output: Python ----------
# -*- coding: utf-8 -*-
""" 
Python Script
Created on  Monday September 2020 12:08:26 
@author:  amd 

[desc]
Description of the plugin Here
Write here any thing... 
[/desc]

ARGUMENTS:
----------
<inp> 
    job_id :[required] - [type = int] - [default = None] 
    Descripe your input here 
        * bullet point.
        * bullet point
</inp>
<inp>
    cookie :[required] - [type = string] - [default = None] 
    Descripe your input here 
        * bullet point.
        * bullet point
</inp>

RETURN:
----------
    <out>
        output : indicate your output description here. \n refers to a new line.
    </out>

"""
import requests, pickle

#API endpoint URL
ApiBase = 'https://api.ensims.com/'
JessApi = ApiBase + "jess_web/api/"

#Load cookie
r = requests.get(JessApi + 'info')
with open(cookie, 'rb') as f:
    r.cookies.update(pickle.load(f))

# GET job output file list by job_id
r = requests.get(JessApi + 'job/dir/' + str(job_id), cookies=r.cookies)

# Show the returned status
output = r.json()
# ---------- end retrieve_job_output ----------
ghpython_script_2 = GhPythonScript(x=panel_19)  # -> out
# ---------- ghpython_script_2: Python ----------
__author__ = "BT"
__version__ = "2020.09.29"

out = x.replace('True','true').replace('False','false')
# ---------- end ghpython_script_2 ----------
ghpython_script_3 = GhPythonScript(x=panel_17)  # -> out; same code as ghpython_script_2
deserialize_json = DeserializeJson(JSON=ghpython_script_2, OutputsLocked=False)  # -> Ok, Status, FileHandle, Callback
url = Panel(format)
deserialize_json_2 = DeserializeJson(JSON=ghpython_script_3, OutputsLocked=False)  # -> Ok, Status, Jwt, User, Role, Email
url_2 = Panel(format_2)
ghpython_script_4 = GhPythonScript(x=check_status)  # -> out; same code as ghpython_script_2
ghpython_script_5 = GhPythonScript(x=retrieve_job_output)  # -> out; same code as ghpython_script_2
post_2 = GhPythonScript(url=format, file=_1)  # -> file, output, data
# ---------- post_2: Python ----------
"""Requests POST method
    Inputs:
        url: The url that contains both base and url
        file: The filepath for the file
    Output:
        data: Requsts response
"""

__author__ = "amd"
__version__ = "2020.11.14"

import scriptcontext as sc
import subprocess

Python3 = sc.sticky['Python3']
JESS_CLI = sc.sticky['JESS_CLI']
cookie = sc.sticky['cookie']

if file == None:
    args = ['post', cookie, url]
else:
    file = str(file)
    args = ['postf', cookie, url, file]

comm = subprocess.Popen([Python3, JESS_CLI] + args, stdout = subprocess.PIPE)
data, error = comm.communicate()
print(data)
comm.stdout.close()
comm.wait()
# ---------- end post_2 ----------
post_3 = GhPythonScript(url=format_2, file=panel_22)  # -> output, data
# ---------- post_3: Python ----------
"""Requests POST method
    Inputs:
        url: The url that contains both base and url
        file: The filepath for the file
    Output:
        data: Requsts response
"""

__author__ = "amd"
__version__ = "2020.11.14"

import scriptcontext as sc
import subprocess

Python3 = sc.sticky['Python3']
JESS_CLI = sc.sticky['JESS_CLI']
cookie = sc.sticky['cookie']

if file == None:
    args = ['post', cookie, url]
else:
    args = ['postf', cookie, url, file]

comm = subprocess.Popen([Python3, JESS_CLI] + args, stdout = subprocess.PIPE)
data, error = comm.communicate()
print(data)
comm.stdout.close()
comm.wait()
# ---------- end post_3 ----------
deserialize_json_3 = DeserializeJson(JSON=ghpython_script_4, OutputsLocked=False)  # -> Ok, Status, Data
deserialize_json_4 = DeserializeJson(JSON=ghpython_script_5, OutputsLocked=False)  # -> Ok, Status, Data
# Where is downloaded file?
panel_24 = Panel(check_status)
panel_25 = Panel(post_2.data)
panel_26 = Panel(post_3.data)
deserialize_json_5 = DeserializeJson(JSON=deserialize_json_3.Data, OutputsLocked=False)  # -> Completion_Time, Cancel_Flag, Last_Update, Status_Info, Job_ID, Progress, Id, Status
deserialize_json_6 = DeserializeJson(JSON=deserialize_json_4.Data, OutputsLocked=False)  # -> FileName, Open, Nocheck, FileSize, Children, Name
ghpython_script_6 = GhPythonScript(x=panel_18)  # -> out; same code as ghpython_script_2
deserialize_json_7 = DeserializeJson(JSON=deserialize_json_6.Children, OutputsLocked=False)  # -> FileName, Open, Nocheck, FileSize, Children, Name
number = Number(deserialize_json_5.Completion_Time)
number_2 = Number(deserialize_json_5.Last_Update)
panel_27 = Panel(deserialize_json_5.Status)
item = Slider(0, range=0..20)
deserialize_json_8 = DeserializeJson(JSON=ghpython_script_6, OutputsLocked=False)  # -> FileName, Open, Nocheck, FileSize, Children, Name
subtraction = Subtraction(A=number_2, B=number)
deserialize_json_9 = DeserializeJson(JSON=deserialize_json_8.Children, OutputsLocked=False)  # -> FileName, Open, Nocheck, FileSize, Children, Name
list_item = ListItem(List=deserialize_json_7.FileName, Index=item, Wrap=True)
panel_28 = Panel(deserialize_json_8.FileName)
panel_29 = Panel(subtraction)
false_start_toggle_4 = FalseStartToggle(False)
filenames = Panel(deserialize_json_7.FileName)
false_start_toggle_5 = FalseStartToggle(False)
panel_30 = Panel(list_item)
panel_31 = Panel(deserialize_json_9.FileName)
deserialize_json_10 = DeserializeJson(JSON=deserialize_json_9.Children, OutputsLocked=False)  # -> FileName, Open, Nocheck, FileSize, Children, Name
text_from_file = TextFromFile(cookie=cookie_2, job_id=job_id, filename=panel_30, run=false_start_toggle_4)  # -> output
# ---------- text_from_file: Python ----------
# -*- coding: utf-8 -*-
""" 
Python Script
Created on  Monday September 2020 12:08:26 
@author:  amd 

[desc]
Description of the plugin Here
Write here any thing... 
[/desc]

ARGUMENTS:
----------
<inp> 
    job_id :[required] - [type = string] - [default = None] 
    Descripe your input here 
        * bullet point.
        * bullet point
</inp>
<inp>
    cookie :[required] - [type = string] - [default = None] 
    Descripe your input here 
        * bullet point.
        * bullet point
</inp>
<inp>
    filename :[required] - [type = string] - [default = None] 
    Descripe your input here 
        * bullet point.
        * bullet point
</inp>

RETURN:
----------
    <out>
        output : indicate your output description here. \n refers to a new line.
    </out>

"""
import requests, pickle

if run == True:
    #API endpoint URL
    ApiBase = 'https://api.ensims.com/'
    JessApi = ApiBase + "jess_web/api/"

    #Load cookie
    r = requests.get(JessApi + 'info')
    with open(cookie, 'rb') as f:
        r.cookies.update(pickle.load(f))

        # GET specific text with job_id and filename
        r = requests.get(JessApi + 'job/file/' + str(job_id) + '/' + filename, cookies=r.cookies)
        
        # Show the returned status
        output = r.text
else:
    output = False
# ---------- end text_from_file ----------
download_job = DownloadJob(job_id=job_id, cookie=cookie_2, folder="C:/Users/amd/Documents/GitHub/JESS-Grasshopper/", run=false_start_toggle_5)  # -> output
# ---------- download_job: Python ----------
# -*- coding: utf-8 -*-
""" 
Python Script
Created on  Monday September 2020 12:08:26 
@author:  amd 

[desc]
Description of the plugin Here
Write here any thing... 
[/desc]

ARGUMENTS:
----------
<inp> 
    job_id :[required] - [type = string] - [default = None] 
    Descripe your input here 
        * bullet point.
        * bullet point
</inp>
<inp>
    cookie :[required] - [type = string] - [default = None] 
    Descripe your input here 
        * bullet point.
        * bullet point
</inp>
<inp>
    folder :[required] - [type = string] - [default = None] 
    Descripe your input here 
        * bullet point.
        * bullet point
</inp>
<inp>
    run :[required] - [type = bool] - [default = False] 
    Descripe your input here 
        * bullet point.
        * bullet point
</inp>

RETURN:
----------
    <out>
        output : indicate your output description here. \n refers to a new line.
    </out>

"""
import requests, pickle, os

if run == True:
    #API endpoint URL
    ApiBase = 'https://api.ensims.com/'
    JessApi = ApiBase + "jess_web/api/"

    #Load cookie
    r = requests.get(JessApi + 'info')
    with open(cookie, 'rb') as f:
        r.cookies.update(pickle.load(f))

    # Download all job output in as a zip file
    r = requests.get(JessApi + 'job/file/' + str(job_id), cookies=r.cookies)

    # Create the download/ folder to save the zip file
    if not os.path.exists(folder):
        try:
            os.mkdir(folder)
        except OSError:
            output = "Creation of the directory %s failed" % folder
        else:
            print ("Successfully created the directory %s " % folder)
    # Save the contents of the downloaded file
    bytes = open(folder + str(job_id) + '.zip', 'wb').write(r.content)
    # Show the returned status
    output = str(bytes) + ' bytes written to ' + folder + job_id + '.zip'
else:
    output = False
# ---------- end download_job ----------
panel_32 = Panel(deserialize_json_10.Name)
panel_33 = Panel(download_job)
panel_34 = Panel(text_from_file)
